# Dynamo custom node 3DSectionBox.Points.dyf (Dynamo 2.3.0.5885)
# category: Zhukoven.Revit.BoundingBoxes
# Extract section boxes from desired 3D views, and convert them into Dynamo Min & Max points. Use these points with "BoundingBox.ByCorners" OOTB node to get the bounding box element.

empty = List.Empty()
Input = Input(: var[]..[])
create = List.Create(item0=empty, item1=Input)
flatten = List.Flatten(list=create)
python_script = Python(IN[0]=flatten)
# ---------- python_script.python (25 lines) ----------
#Author Konstantin Zhukoven @ https://zhukoven.com
#Tested to work with Dynamo 1.3.0+
import clr
clr.AddReference("RevitAPI")
import Autodesk
from Autodesk.Revit.DB import *

clr.AddReference("RevitNodes")
import Revit
clr.ImportExtensions(Revit.GeometryConversion)
clr.ImportExtensions(Revit.Elements)

clr.AddReference("RevitServices")
import RevitServices
from RevitServices.Persistence import DocumentManager
from RevitServices.Transactions import TransactionManager

doc = DocumentManager.Instance.CurrentDBDocument
view = UnwrapElement(IN[0])
bmin, bmax = [], []
for i in view:
	bmax.append(i.GetSectionBox().Max.ToPoint())
	bmin.append(i.GetSectionBox().Min.ToPoint())

OUT = bmin, bmax
# ----------------------------------------
code_block = CodeBlock(seq=python_script) { seq[0]; seq[1]; }
min = Output(code_block.out0)  # Use these points with "BoundingBox.ByCorners" OOTB node
max = Output(code_block.out1)  # Use these points with "BoundingBox.ByCorners" OOTB node
