# Dynamo custom node AllElementsOfCategoryAtLevel.dyf (Dynamo 2.3.0.5885)
# category: Zhukoven.Revit.Element
# Select all elements of the specified category at the specified level.

level = Input(level: var[]..[])
all_elements_at_level = ElementsAtLevel(Level=level)
getCategory = Element.GetCategory(element=all_elements_at_level)
id = Category.Id(category=getCategory)
category = Input(category: Revit.Elements.Category)
id_2 = Category.Id(category=category)
code_block = CodeBlock(a=id, b=id_2) { a==b; }
filterByBoolMask = List.FilterByBoolMask(list=all_elements_at_level, mask=code_block)
Elements = Output(filterByBoolMask.in)
