# Dynamo custom node AreaReinforcement.GetRebarSets.dyf (Dynamo 1.3.2.2480)
# category: Zhukoven.Revit.Rebar
# This node extracts all the rebar sets from the input Structural Area Reinforcement element. The output elements are shown as "RebarInSystem".

AreaReinforcement = Input()  # Input Structural Area Reinforcement Element
python_script = Python(IN[0]=AreaReinforcement)
# ---------- python_script.python (26 lines) ----------
#Author Konstantin Zhukoven @ https://zhukoven.com
#Tested to work with Dynamo 1.3.0+
import clr
clr.AddReference('RevitAPI')
from Autodesk.Revit.DB import *
from Autodesk.Revit.DB.Structure import *

clr.AddReference('RevitNodes')
import Revit
clr.ImportExtensions(Revit.GeometryConversion)
clr.ImportExtensions(Revit.Elements)

clr.AddReference('RevitServices')
import RevitServices
from RevitServices.Persistence import DocumentManager
from RevitServices.Transactions import TransactionManager

doc = DocumentManager.Instance.CurrentDBDocument
rebarArea = UnwrapElement(IN[0])
rebarInSystem = rebarArea.GetRebarInSystemIds()

rebarSet = []

for i in rebarInSystem:
	rebarSet.append(doc.GetElement(i))
OUT = rebarSet
# ----------------------------------------
RebarSets = Output(python_script)
