# Dynamo custom node ContinuousRail.GetHost.dyf (Dynamo 1.3.0.875)
# category: Zhukoven.Revit.Railings
# Get host railing element for the input continuous rail.

ContinuousRail = Input()  # Input railing element
python_script = Python(IN[0]=ContinuousRail)
# ---------- python_script.python (21 lines) ----------
#Tested in Revit 2016+ and Dynamo 1.3.0 
#Author © Konstantin Zhukoven @ https:\\zhukoven.com
import clr
clr.AddReference('RevitAPI')
from Autodesk.Revit.DB import *

clr.AddReference("RevitNodes")
import Revit
clr.ImportExtensions(Revit.Elements)

clr.AddReference("RevitServices")
import RevitServices
from RevitServices.Persistence import DocumentManager
doc = DocumentManager.Instance.CurrentDBDocument

contRail = UnwrapElement(IN[0])
for i in contRail:
	contHost = i.HostRailingId
	railing = doc.GetElement(contHost)
#Output
OUT = railing
# ----------------------------------------
Railing = Output(python_script)
