# Dynamo custom node Coordinates.MoveSurveyPoint.dyf (Dynamo 1.3.2.2480)
# category: Zhukoven.Revit.Coordinates
# Shift survey point elevation (Z) by the given value. Input boolean switch (True) to move up, or (False) to move down.

UpDown = Input(UpDown : bool = True)  # Direction to move Z coordinate (bool)
Offset = Input()
code_block = CodeBlock(Z=Offset) { Z*(-1); }
if_ = If(test=UpDown, true=code_block, false=Offset)
byCoordinates = Point.ByCoordinates(z=if_)
python_script = Python(IN[0]=byCoordinates)
# ---------- python_script.python (51 lines) ----------
#Author Konstantin Zhukoven @ https://zhukoven.com
#Tested to work with Dynamo 1.3.0+

import clr
clr.AddReference('ProtoGeometry')
from Autodesk.DesignScript.Geometry import *

clr.AddReference("RevitNodes")
import Revit
clr.ImportExtensions(Revit.GeometryConversion)

# Import DocumentManager and TransactionManager
clr.AddReference("RevitServices")
import RevitServices
from RevitServices.Transactions import TransactionManager
from RevitServices.Persistence import DocumentManager
doc = DocumentManager.Instance.CurrentDBDocument

# Import RevitAPI
clr.AddReference("RevitAPI")
import Autodesk
from Autodesk.Revit.DB import *

movetoPoint = IN[0]
isSurvey = True

#Check if shared coordinates are enabled
if isSurvey:
	basePoint = FilteredElementCollector(doc).OfCategory(BuiltInCategory.OST_SharedBasePoint).ToElements()
else:
	basePoint = FilteredElementCollector(doc).OfCategory(BuiltInCategory.OST_ProjectBasePoint).ToElements()
	
baseEW = BuiltInParameter.BASEPOINT_EASTWEST_PARAM
baseNS = BuiltInParameter.BASEPOINT_NORTHSOUTH_PARAM
baseElevation = BuiltInParameter.BASEPOINT_ELEVATION_PARAM

eastWest = basePoint[0].get_Parameter(baseEW).AsDouble()
northSouth = basePoint[0].get_Parameter(baseNS).AsDouble()
elevation = basePoint[0].get_Parameter(baseElevation).AsDouble()

createPoint = Autodesk.DesignScript.Geometry.Point.ByCoordinates(eastWest, northSouth, elevation)

TransactionManager.Instance.EnsureInTransaction(doc)
sp = []
for i in basePoint:
	sp.append(i.IsShared)
	sp.append(i.Pinned)
	sp.append(i.Location.Move(movetoPoint.ToXyz()))
	
TransactionManager.Instance.TransactionTaskDone()
OUT = basePoint, createPoint, sp
# ----------------------------------------
code_block_2 = CodeBlock(seq=python_script) { seq[0]; seq[1]; seq[2]; }
SurveyPoint = Output(code_block_2.out0)
Point = Output(code_block_2.out1)
code_block_3 = CodeBlock(seq=code_block_2.out2) { seq[0]; seq[1]; seq[2]; }
isShared = Output(code_block_3.out0)  # Boolean
isPinned = Output(code_block_3.out1)  # Boolean
Moved = Output(code_block_3.out2)  # Boolean
