# Dynamo custom node Document.ActiveWorkset.dyf (Dynamo 1.3.0.875)
# category: Zhukoven.Revit.Document
# Get active workset name from the current document.

Reset = Input(Reset : bool = false)
python_script = Python(IN[0]=Reset)
# ---------- python_script.python (22 lines) ----------
#Author Konstantin Zhukoven @ https://zhukoven.com
#Tested to work with Dynamo 1.3.0+
import clr
clr.AddReference("RevitNodes")
import Revit

# Import DocumentManager and TransactionManager
clr.AddReference("RevitServices")
import RevitServices
from RevitServices.Persistence import DocumentManager
# Import RevitAPI
clr.AddReference("RevitAPI")
import Autodesk
from Autodesk.Revit.DB import *

doc = DocumentManager.Instance.CurrentDBDocument

wsTable = doc.GetWorksetTable()
activeId = wsTable.GetActiveWorksetId()
wsname = wsTable.GetWorkset(activeId).Name

OUT = wsname
# ----------------------------------------
WorksetName = Output(python_script)
