# Dynamo custom node Document.CentralModelPath.dyf (Dynamo 1.3.0.875)
# category: Zhukoven.Revit.Document
# Extracts file path of the central model. Works from within both Central and Local workshared models. Returns null if worksharing is disabled in current Document.

python_script = Python()  # unwired: IN[0]
# ---------- python_script.python (23 lines) ----------
#Tested in Revit 2016+ and Dynamo 1.3.0 
#Author © Konstantin Zhukoven @ https:\\zhukoven.com
import clr
#Import Revit Services
clr.AddReference("RevitServices")
import RevitServices
from RevitServices.Persistence import DocumentManager
from RevitServices.Transactions import TransactionManager

#Import Revit API
clr.AddReference("RevitAPI")
import Autodesk
from Autodesk.Revit.DB import *

doc = DocumentManager.Instance.CurrentDBDocument

#Start Transaction
TransactionManager.Instance.EnsureInTransaction(doc)

centralpath = doc.GetWorksharingCentralModelPath() 
mpath = ModelPathUtils.ConvertModelPathToUserVisiblePath(centralpath)

OUT = mpath
# ----------------------------------------
filePath = Output(python_script)
