# Dynamo custom node Document.Close.dyf (Dynamo 2.3.0.5885)
# category: Zhukoven.Revit
# Close current Revit document. Use boolean switch (true / false) to save / discard any changes.

document = Input(document: var[]..[])
code_block = CodeBlock(t2=document) { t1 = [t2]; t3 = DSCore.List.Flatten(t1); }
save = Input(save: bool = false)
python_script = Python(IN[0]=code_block.t3, IN[1]=save)
# ---------- python_script.python (17 lines) ----------
#Tested in Revit 2016+ and Dynamo 1.3.0 
#Author © Konstantin Zhukoven @ https:\\zhukoven.com
#Import system libraries
import sys
pyt_path = r'C:\Program Files (x86)\IronPython 2.7\Lib'
sys.path.append(pyt_path)
import clr
clr.AddReference("RevitServices")
from RevitServices.Persistence import DocumentManager
app = DocumentManager.Instance.CurrentUIApplication.Application
doc = IN[0]
saveDoc = IN[1]
#Output
closed = []
for i in doc:
	closed.append(i.Close(saveDoc))
OUT = closed
# ----------------------------------------
Saved = Output(python_script)  # Boolean
