# Dynamo custom node Document.DateInfo.dyf (Dynamo 1.3.0.875)
# category: Zhukoven.Revit.Document
# Input file path to get its created and last saved dates. This node uses built-in python functions, so that all the file extensions are supported (Revit documents, images, text files, etc.). If you input current unsaved Revit document (detached central model, for instance), the node will return null values.

Filepath = Input()  # Input file path (use OOTB "File Path" or "Document.FilePath" node)
python_script = Python(IN[0]=Filepath)
# ---------- python_script.python (30 lines) ----------
#Tested in Revit 2016+ and Dynamo 1.3.0 
#Author © Konstantin Zhukoven @ https:\\zhukoven.com
#Import system libraries
import sys
pyt_path = r'C:\Program Files (x86)\IronPython 2.7\Lib'
sys.path.append(pyt_path)
import os
from datetime import datetime
import clr
#Import Revit Services
clr.AddReference("RevitServices")
import RevitServices
from RevitServices.Persistence import DocumentManager
from RevitServices.Transactions import TransactionManager

#Import Revit API
clr.AddReference("RevitAPI")
import Autodesk
from Autodesk.Revit.DB import *

doc = DocumentManager.Instance.CurrentDBDocument
filepath = ModelPathUtils.ConvertUserVisiblePathToModelPath(IN[0])
mpath = ModelPathUtils.ConvertModelPathToUserVisiblePath(filepath)
#Start Transaction
TransactionManager.Instance.EnsureInTransaction(doc)

dc = datetime.fromtimestamp(os.path.getctime(mpath))
dm = datetime.fromtimestamp(os.path.getmtime(mpath))

OUT = [dc.date(), dm.date()]
# ----------------------------------------
code_block = CodeBlock { 0; }
getItemAtIndex = List.GetItemAtIndex(list=python_script, index=code_block)
Created = Output(getItemAtIndex)
code_block_2 = CodeBlock { 1; }
getItemAtIndex_2 = List.GetItemAtIndex(list=python_script, index=code_block_2)
LastSave = Output(getItemAtIndex_2)
