# Dynamo custom node Document.Open.dyf (Dynamo 2.3.0.5885)
# category: Zhukoven.Revit
# Open document from the input File Path

FilePath = Input(FilePath: var[]..[])
code_block = CodeBlock(t2=FilePath) { t1 = [t2]; t3 = DSCore.List.Flatten(t1); }
python_script = Python(IN[0]=code_block.t3)
# ---------- python_script.python (16 lines) ----------
#Tested in Revit 2016+ and Dynamo 1.3.0 
#Author © Konstantin Zhukoven @ https:\\zhukoven.com
#Import system libraries
import sys
pyt_path = r'C:\Program Files (x86)\IronPython 2.7\Lib'
sys.path.append(pyt_path)
import clr
clr.AddReference("RevitServices")
from RevitServices.Persistence import DocumentManager
app = DocumentManager.Instance.CurrentUIApplication.Application
filePath = IN[0]
opened = []
#Output
for i in filePath:
	opened.append(app.OpenDocumentFile(i))
OUT = opened
# ----------------------------------------
Document = Output(python_script)
