# Dynamo custom node Document.Username.dyf (Dynamo 1.3.0.875)
# category: Zhukoven.Revit.Document
# Extracts username from the current Revit application instance.

python_script = Python()  # unwired: IN[0]
# ---------- python_script.python (13 lines) ----------
#Tested in Revit 2016+ and Dynamo 1.3.0 
#Author © Konstantin Zhukoven @ https:\\zhukoven.com
#Import system libraries
import sys
pyt_path = r'C:\Program Files (x86)\IronPython 2.7\Lib'
sys.path.append(pyt_path)
import clr
clr.AddReference("RevitServices")
from RevitServices.Persistence import DocumentManager
app = DocumentManager.Instance.CurrentUIApplication.Application

#Output
OUT = app.Username
# ----------------------------------------
Username = Output(python_script)
