# Dynamo custom node Element.CopyID.dyf (Dynamo 2.3.0.5885)
# category: Zhukoven.Revit
# This node copies element's ID to clipboard.

element = Input(element: Revit.Elements.Element)  # Input single element to copy its ID to clipboard
id = Element.Id(element=element)
string_from_object = FromObject(obj=id)
python_script = Python(IN[0]=string_from_object)
# ---------- python_script.python (18 lines) ----------
#Refer to https://github.com/andydandy74/ClockworkForDynamo
import clr
import System
from System.Threading import Thread, ThreadStart
clr.AddReference("System.Windows.Forms")

def SetText(text):
    def thread_proc():
        System.Windows.Forms.Clipboard.SetText(text)
    t = Thread(ThreadStart(thread_proc))
    t.ApartmentState = System.Threading.ApartmentState.STA
    t.Start()
    
try:
	SetText(IN[0])
	OUT = IN[0]
except:
	OUT = 'Error: element ID could not be copied to clipboard'
# ----------------------------------------
id_2 = Output(python_script)  # "id"
