# Dynamo custom node Element.FlipWorkplane.dyf (Dynamo 1.3.3.4111)
# category: Zhukoven.Revit.Elements
# Flip workplane for single or multiple elements. Input element(s) and boolean (true / false).

Element = Input()  # "Element[]"
boolean = Input(boolean : var[]..[])
count = Count(Element)
ofRepeatedItem = List.OfRepeatedItem(item=boolean, amount=count)
python_script = Python(IN[0]=Element, IN[1]=ofRepeatedItem)
# ---------- python_script.python (27 lines) ----------
#Many thanks to Daniel_Woodcock1 for posting the code on foum.dynamobim.com
import clr

clr.AddReference("RevitServices")
import RevitServices
from RevitServices.Persistence import DocumentManager
from RevitServices.Transactions import TransactionManager
doc =  DocumentManager.Instance.CurrentDBDocument

clr.AddReference("RevitNodes")
import Revit
clr.ImportExtensions(Revit.Elements)
clr.ImportExtensions(Revit.GeometryConversion)

clr.AddReference("RevitAPI")
from Autodesk.Revit.DB import *

def tolist(obj1):
	if hasattr(obj1,"__iter__"): return obj1
	else: return [obj1]

elems = tolist(UnwrapElement(IN[0]))
bools = tolist(IN[1])
TransactionManager.Instance.EnsureInTransaction(doc)
for elem,b in zip(elems, bools):
	elem.IsWorkPlaneFlipped = b
TransactionManager.Instance.TransactionTaskDone()
# ----------------------------------------
