# Dynamo custom node FacadePanel.ImportInLegend.dyf (Dynamo 1.3.0.875)
# category: Zhukoven.Revit.Views
# Use this node to annotate facade panels in Legends or Drafring views. Select your system panel (or an adaptive component), then choose the destination view and its plane. The node will import selected panel into the view, allowing you to place dimensions and annotate each component. You may use the View.Plane node from the Clockwork package to get the view's plane as an input. Use the output point as location point to place annotation text.

FacadePanel = Input(FacadePanel : Element)  # Input system or adaptive facade panel here. *NOTE* Processes only one panel at a time!
geometry = Element.Geometry(FacadePanel)
faces = Element.Faces(FacadePanel)
area = Surface.Area(faces)
maximumItem = List.MaximumItem(area)
code_block = CodeBlock(area=area, max=maximumItem) { area==max; }
filterByBoolMask = List.FilterByBoolMask(list=faces, mask=code_block)
firstItem = List.FirstItem(filterByBoolMask.in)
code_block_2 = CodeBlock()
# ---------- code_block_2.designscript (2 lines) ----------
//Center parameter
0.5;
# ----------------------------------------
coordinateSystemAtParameter = Surface.CoordinateSystemAtParameter(firstItem, code_block_2, code_block_2)
LegendViewPlane = Input(LegendViewPlane : Plane)  # Input the 2D plane from the chosen Legend / Drafting view (use the View.Plane node from the Clockwork package, for instance)
toCoordinateSystem = Plane.ToCoordinateSystem(LegendViewPlane)
transform = Geometry.Transform(geometry=geometry, fromCoordinateSystem=coordinateSystemAtParameter, contextCoordinateSystem=toCoordinateSystem)
YAxis = Plane.YAxis(LegendViewPlane)

# group: Getting adaptive component rotation to correctly import instance into the legend
explode = Geometry.Explode(transform)
flatten = Flatten(explode)
area_2 = Surface.Area(flatten)
maximumItem_2 = List.MaximumItem(area_2)
eq = area_2 == maximumItem_2
filterByBoolMask_2 = List.FilterByBoolMask(list=flatten, mask=eq)
firstItem_2 = List.FirstItem(filterByBoolMask_2.in)
perimeterCurves = Surface.PerimeterCurves(firstItem_2)
length = Curve.Length(perimeterCurves)
code_block_3 = CodeBlock(length=length) { length>1000; }
filterByBoolMask_3 = List.FilterByBoolMask(list=length, mask=code_block_3)
minimumItem = List.MinimumItem(filterByBoolMask_3.in)
containsItem = List.ContainsItem(list=length, item=minimumItem, lacing=Longest)
filterByBoolMask_4 = List.FilterByBoolMask(list=perimeterCurves, mask=containsItem)
firstItem_3 = List.FirstItem(filterByBoolMask_4.in)
startPoint = Curve.StartPoint(firstItem_3)
endPoint = Curve.EndPoint(firstItem_3)
byStartPointEndPoint = Line.ByStartPointEndPoint(startPoint=startPoint, endPoint=endPoint)
direction = Line.Direction(byStartPointEndPoint)
angleWithVector = Vector.AngleWithVector(vector=YAxis, otherVector=direction)
code_block_4 = CodeBlock(angle=angleWithVector) { angle*(-1); }
code_block_5 = CodeBlock(angle=code_block_4) { angle-90; }
rotate = Geometry.Rotate(transform, LegendViewPlane, code_block_5)

# group: Result
byGeometry = ImportInstance.ByGeometry(rotate)
centroid = Solid.Centroid(rotate)

Element = Output(byGeometry)  # Imported element
Point = Output(centroid)  # Location point
