# Dynamo custom node Families.BatchUpdate.dyf (Dynamo 1.3.2.2480)
# category: Zhukoven.Revit.Families
# Input directory path to upgrade all the *.rfa families inside this folder to your currently opened Revit version. Don't forget to backup these families before using the node.

DirectoryPath = Input()  # Input Directory Path (string)
fromPath = DirectoryObject(DirectoryPath)  # "Directory.FromPath"
code_block = CodeBlock { "*.rfa"; }
contents = Directory.Contents(fromPath, code_block)
open = Custom[Document.Open](FilePath=contents)  # Open document from the input File Path
boolean = BoolSelector(true)
close = Custom[Document.Close](Document=open, Save=boolean)  # Close current Revit document. Use boolean switch (true / false) to save / discard any changes.
Saved = Output(close)  # Boolean
