# Dynamo custom node FamilyInstance.ByPointEachRun.dyf (Dynamo 2.3.0.5885)
# category: Zhukoven.Revit
# Place family instance by point each time you hit the 'Run' button without deleting previously placed ones. Don't use this node in 'Auto' mode!

familyType = Input(familyType: var[]..[])
points = Input(points: var[]..[])
python_script = Python(IN[0]=familyType, IN[1]=points)
# ---------- python_script.python (34 lines) ----------
#Based on Bakery node 'Family instance by point in transaction'
import clr
clr.AddReference('RevitAPI')
from Autodesk.Revit.DB import *

clr.AddReference("RevitNodes")
import Revit
clr.ImportExtensions(Revit.Elements)
clr.ImportExtensions(Revit.GeometryConversion)

clr.AddReference("RevitServices")
import RevitServices
from RevitServices.Persistence import DocumentManager
from RevitServices.Transactions import TransactionManager
from Autodesk.Revit.DB.Structure import *

doc = DocumentManager.Instance.CurrentDBDocument
famtype = UnwrapElement(IN[0])
points = UnwrapElement(IN[1])

elementlist = list()

ST = StructuralType.NonStructural

TransactionManager.Instance.EnsureInTransaction(doc)
# Make sure the familysymbol is active
if famtype.IsActive == False:
	famtype.Activate()
	doc.Regenerate()
for point in points:
	newobj = doc.Create.NewFamilyInstance(point.ToXyz(),famtype,ST)
	elementlist.append(newobj)
TransactionManager.Instance.TransactionTaskDone()
OUT = elementlist
# ----------------------------------------
FamilyInstance = Output(python_script)
