# Dynamo custom node Insert.LinkRevit.dyf (Dynamo 1.3.0.875)
# category: Zhukoven.Revit.Links
# Link Revit model into your current document

FilePath = Input()
python_script = Python(IN[0]=FilePath)
# ---------- python_script.python (42 lines) ----------
#Tested on Dynamo 1.3.0
import clr
clr.AddReference('ProtoGeometry')
from Autodesk.DesignScript.Geometry import *
# Import ToDSType(bool) extension method
clr.AddReference("RevitNodes")
import Revit
clr.ImportExtensions(Revit.Elements)
# Import geometry conversion extension methods
clr.ImportExtensions(Revit.GeometryConversion)
# Import DocumentManager and TransactionManager
clr.AddReference("RevitServices")
import RevitServices
from RevitServices.Persistence import DocumentManager
from RevitServices.Transactions import TransactionManager
from System.Collections.Generic import *
# Import RevitAPI
clr.AddReference("RevitAPI")
import Autodesk
from Autodesk.Revit.DB import *

doc = DocumentManager.Instance.CurrentDBDocument
uiapp = DocumentManager.Instance.CurrentUIApplication
app = uiapp.Application
uidoc=DocumentManager.Instance.CurrentUIApplication.ActiveUIDocument

# Start Transaction
TransactionManager.Instance.EnsureInTransaction(doc)

# Create the Revit Link Type
# creae a for loop
filepath = ModelPathUtils.ConvertUserVisiblePathToModelPath(UnwrapElement(IN[0]))
linkoptions = RevitLinkOptions("")
loadedLnkType = RevitLinkType.Create(doc, filepath, linkoptions)
 
# Create the Revit Link Instance
lnkInstance = RevitLinkInstance.Create(doc, loadedLnkType.ElementId)

# End Transaction
TransactionManager.Instance.TransactionTaskDone()

OUT="Successfully loaded"
# ----------------------------------------
Result = Output(python_script)
