# Dynamo custom node List.ContainsItems.dyf (Dynamo 1.3.3.4651)
# category: Zhukoven.DynamoCore
# Checks if each item of a given list matches at least one item of another list

list = Input(list : var[]..[])
items = Input(items : var[]..[])
containsItem = List.ContainsItem(list=list, item=items, lacing=CrossProduct)
uniqueItems = List.UniqueItems(containsItem@L2)
sort = List.Sort(uniqueItems)
reverse = List.Reverse(sort@L2)
code_block = CodeBlock { 0; }
getItemAtIndex = List.GetItemAtIndex(list=reverse@L2, index=code_block)
bool = Output(getItemAtIndex)
