# Dynamo custom node List.ContainsNull.dyf (Dynamo 1.3.2.2480)
# category: Zhukoven.DynamoCore
# Check if the input list contains null items

list = Input(list : var[]..[])
code_block = CodeBlock { null; }
containsItem = List.ContainsItem(list=list, item=code_block)
bool = Output(containsItem)
