# Dynamo custom node List.MultiplyByAnotherList.dyf (Dynamo 1.3.3.4651)
# category: Zhukoven.DynamoCore
# Multiplies each item of a given list by unique number given in another list. Works for equal lists

item = Input(item : var[]..[])
code_block = CodeBlock { 0; 1; }
sublists = List.Sublists(list=item, ranges=code_block.out0, offset=code_block.out1)
amount = Input(amount : var[]..[])
sublists_2 = List.Sublists(list=amount, ranges=code_block.out0, offset=code_block.out1)
ofRepeatedItem = List.OfRepeatedItem(item=sublists@L2, amount=sublists_2@L2)
flatten = Flatten(ofRepeatedItem@L3)
transpose = List.Transpose(flatten@L2)
lists = Output(transpose)
