# Dynamo custom node List.SplitByString.dyf (Dynamo 1.3.3.4111)
# category: Zhukoven.DynamoCore
# This node will split the input list of strings into the separate lists. Does not work with numbers and with empty separators (for example, "").

list = Input()  # Input list of strings
separater = Input()  # Input string as a separater
python_script = Python(IN[0]=list, IN[1]=separater)
# ---------- python_script.python (13 lines) ----------
from itertools import groupby

oldList = IN[0]
def breakby(oldList, sep, delim=None):
	for i in oldList:
		p = i.split(sep)
		yield p[0]
		if len(p) > 1:
			yield delim
			yield p[1]
newList = [list(g) for k,g in groupby(breakby(oldList, IN[1], None), lambda x: x is not None) if k]

OUT = newList
# ----------------------------------------
lists = Output(python_script)
