# Dynamo custom node Math.AddEachPreviousItemInList.dyf (Dynamo 1.3.2.2480)
# category: Zhukoven.DynamoCore
# This node adds each previous item in the input list. For example: input list of these values: [4, 2, 1, 3] will result in their sums: [4, 6, 7, 10]

values = Input()  # double[]
python_script = Python(IN[0]=values)
# ---------- python_script.python (10 lines) ----------
#Author Konstantin Zhukoven @ https://zhukoven.com
l = IN[0]
newList = []
def add_one_by_one(l):
	cumsum = 0
	for elt in l:
		cumsum += elt
		yield cumsum
newList = list(add_one_by_one(l))
OUT = newList
# ----------------------------------------
list = Output(python_script)  # double[]
