# Dynamo custom node Math.MultiplyAllValuesInList.dyf (Dynamo 1.3.3.4111)
# category: Zhukoven.DynamoCore
# This node simply multiplies all values in the given list.

values = Input()  # double[]
python_script = Python(IN[0]=values)
# ---------- python_script.python (9 lines) ----------
def multiply(myList) : 
	# Multiply elements one by one 
	result = 1
	for i in myList: 
		result = result * i  
	return result  

lst = IN[0]
OUT = multiply(lst)
# ----------------------------------------
list = Output(python_script)  # double[]
