# Dynamo custom node MultilineText.FromList.dyf (Dynamo 1.3.0.875)
# category: Zhukoven.Revit.Text
# Convert the input list to multiline string.

List = Input()
string_from_object = FromObject(List)
python_script = Python(IN[0]=string_from_object)
# ---------- python_script.python (3 lines) ----------
lst = IN[0]
jnd = str('\n'.join(lst))
OUT = jnd
# ----------------------------------------
MultilineText = Output(python_script)  # Output string with breaks
