# Dynamo custom node MultilineText.Strings.dyf (Dynamo 2.3.0.5885)
# category: Zhukoven.Revit
# Extract each line from multiline text parameter as a list of strings.

multilineText = Input(multilineText: var[]..[])  # Input multiline text parameter value (single string with multiple lines)
python_script = Python(IN[0]=multilineText)
# ---------- python_script.python (12 lines) ----------
#Tested in Revit 2016+ and Dynamo 1.3.0 
#Author © Konstantin Zhukoven @ https:\\zhukoven.com
import clr
clr.AddReference('ProtoGeometry')
from Autodesk.DesignScript.Geometry import *
#Введенные в этом узле данные сохраняется в виде списка в переменных IN.
dataEnteringNode = IN
mline = IN[0]
nlines = mline.splitlines()
count = len(nlines)
#Назначьте вывод переменной OUT.
OUT = nlines
# ----------------------------------------
strings = Output(python_script)
