# Dynamo custom node Navisworks.CreateSearchSet.dyf (Dynamo 1.3.0.875)
# category: Zhukoven.Navisworks
# Based on original code by Luke Johnson, this node gives the freedom in Navisworks XML file creation. You're able to specify the Navisworks Search Set name & group, and choose which Navisworks parameter you're going to use. Don't use this node in Auto mode. Be careful to backup your XML files before each run, if you're not going to overwrite them.

# note: Resulting file
XMLfile = Input()  # File path (write with .XML extension)
code_block = CodeBlock { ""; }
string = StringInput("""<?xml version="1.0" encoding="UTF-8" ?>

<exchange xmlns:xsi="http://www.w3.org/2001/XMLSchema-instance" xsi:noNamespaceSchemaLocation="http://download.autodesk.com/us/navisworks/schemas/nw-exchange-12.0.xsd">
  <selectionsets>
    <viewfolder name="SearchByID" guid="2e23618a-ac82-4cfd-84b2-b72e4e5deb16">
      <selectionset name="DynamoSearchSet" guid="7d9883e2-5286-40f6-8186-817edb6870c8">
        <findspec mode="all" disjoint="0">
          <conditions>""")
RevitDataset = Input(RevitDataset : var[]..[])  # Input list of values according to the Navisworks parameter (list)
string_from_object = FromObject(RevitDataset)
code_block_2 = CodeBlock { ""; }
# note: Original code by Luke Johnson (http:\\wrw.is)
# Modified to get more control over the inputs
string_2 = StringInput("""<condition test="equals" flags="74">
              <category>
                <name internal="LcRevitData_Element">TAB</name>
              </category>
              <property>
                <name internal="LcRevitPropertyElementId">PARAM</name>
              </property>
              <value>
                <data type="int32">""")
NavisPropertiesTab = Input()  # Choose which Navis options tab holds the desired parameter (str)
code_block_3 = CodeBlock(t2=string_2, t3=NavisPropertiesTab) { t4 = String.Replace(t2, "TAB", t3); }
NavisParameter = Input()  # Choose the desired Navis parameter (str)
code_block_4 = CodeBlock(t2=code_block_3, t3=NavisParameter) { t4 = String.Replace(t2, "PARAM", t3); }
string_3 = StringInput("""</data>
              </value>
            </condition>""")
join = String.Join(code_block_2, code_block_4, arg3=string_3)  # unwired: arg2
map = List.Map(list=string_from_object, f_x=join)
# note: XML header and footer
create = List.Create(map)
python_script = Python(IN[0]=create, IN[1]=code_block)
# ---------- python_script.python (3 lines) ----------
initial = IN[0]
result = map(IN[1].join, initial)
OUT=result
# ----------------------------------------
firstItem = List.FirstItem(python_script)
string_4 = StringInput("""          </conditions>
          <locator>/</locator>
        </findspec>
      </selectionset>
    </viewfolder>
  </selectionsets>
</exchange>""")
join_2 = String.Join(code_block, string, firstItem, string_4)
# note: Name and group search sets in Navisworks
code_block_5 = CodeBlock()
# ---------- code_block_5.designscript (3 lines) ----------
//Replacing XML data with Input
"SearchByID";
"DynamoSearchSet";
# ----------------------------------------
SearchSetGroup = Input()  # Name the search set group (str)
replace = String.Replace(str=join_2, searchFor=code_block_5.out0, replaceWith=SearchSetGroup)
SearchSetName = Input()  # Name the search set (str)
replace_2 = String.Replace(str=replace, searchFor=code_block_5.out1, replaceWith=SearchSetName)
writeToFile = CSV.WriteToFile(XMLfile, replace_2)
Result = Output(replace_2)
