# Dynamo custom node Navisworks.ExportCache.dyf (Dynamo 1.3.1.1736)
# category: Zhukoven.Navisworks
# ***NOTE*** This node needs Navisworks Exporters for Revit addin to export cache files!
# Use this node to export Navisworks cache from the current Revit document. You may choose one or multiple 3D-views to export, but be sure to provide their names as strings. Use the "ExportLinks" boolean switch to export Revit linked files. Toggle Reset if Dynamo refuses to export cache.

DirectoryPath = Input()  # Select an output folder (directory path)
current = Document.Current()
filePath = Document.FilePath(current)
code_block = CodeBlock { false; }
fileName = FilePath.FileName(filePath, code_block)
ViewName = Input(ViewName = Navisworks)  # Provide the view name as string
ViewNameAsSuffix = Input(ViewNameAsSuffix: bool = false)  # Boolean: true to add a view name suffix to the filename
ExportLinks = Input(ExportLinks: bool = false)  # Boolean: true to export linked files visible in selected views
Reset = Input(Reset: bool = false)  # Use the switch to reset the node
python_script = Python(IN[0]=DirectoryPath, IN[1]=fileName, IN[2]=ViewName, IN[3]=ViewNameAsSuffix, IN[4]=ExportLinks, IN[5]=Reset)
# ---------- python_script.python (35 lines) ----------
import clr
# Import DocumentManager and TransactionManager
clr.AddReference("RevitServices")
import RevitServices
from RevitServices.Persistence import DocumentManager
doc = DocumentManager.Instance.CurrentDBDocument

clr.AddReference("RevitAPI")
import Autodesk
from Autodesk.Revit.DB import *

collector = FilteredElementCollector(doc).OfClass(View)
options = NavisworksExportOptions()
options.ConvertElementProperties = True
options.ExportScope = NavisworksExportScope.View

dirpath = IN[0]
filename = IN[1]
viewname = IN[2]
toggle = IN[3]
exportlinks = IN[4]

if exportlinks == True:
	options.ExportLinks = True
else:
	options.ExportLinks = False

for view in collector:
    if view.ViewType == ViewType.ThreeD and view.Name.Contains(viewname):
        options.ViewId = view.Id
        if toggle == True:
        	doc.Export(dirpath, filename + "-" + view.Name + ".nwc", options)
        else: 
        	doc.Export(dirpath, filename + ".nwc", options)
OUT = dirpath
# ----------------------------------------
DirPath = Output(python_script)  # Folder path as String
