# Dynamo custom node OS.CurrentUserInfo.dyf (Dynamo 1.3.2.2480)
# category: Zhukoven
# Get current user logged in info: username, appdata path and desktop path. Desktop path works also for the Microsoft Windows roaming profiles and localized OS versions.

python_script = Python()  # unwired: IN[0]
# ---------- python_script.python (17 lines) ----------
#Author Konstantin Zhukoven @ https://zhukoven.com
#Tested to work with Dynamo 1.3.0+
import clr
import sys
pyt_path = r'C:\Program Files (x86)\IronPython 2.7\Lib'
sys.path.append(pyt_path)

import os
from os.path import expanduser
username = os.getenv('username')
appdata = os.path.expandvars('%appdata%')
#Workaround for Microsoft Windows roaming profiles to get current user's desktop path:
userpath = appdata.split("\AppData")
first = userpath[0]
desktop = os.path.join(first, 'Desktop')

OUT = username, appdata, desktop
# ----------------------------------------
code_block = CodeBlock(seq=python_script) { seq[0]; seq[1]; seq[2]; }
Username = Output(code_block.out0)  # Current user logged in (string)
Appdata = Output(code_block.out1)  # DirectoryPath (string)
Desktop = Output(code_block.out2)  # DirectoryPath (string)
