# Dynamo custom node OpenIFC.dyf (Dynamo 1.3.2.2480)
# category: Zhukoven.IFC
# Opens an IFC document from disk using default options, and converts it to Revit document.

IFC = Input()  # Input file path to IFC Document
SaveAs = Input()  # Input file path to resulting "revit filename.rvt"
python_script = Python(IN[0]=IFC, IN[1]=SaveAs)
# ---------- python_script.python (36 lines) ----------
#Author Konstantin Zhukoven @ https://zhukoven.com
#Tested to work with Dynamo 1.3.0+
import clr
clr.AddReference("RevitAPI")
import Autodesk
from Autodesk.Revit.DB import *

clr.AddReference("RevitNodes")
import Revit
clr.ImportExtensions(Revit.GeometryConversion)
clr.ImportExtensions(Revit.Elements)

clr.AddReference("RevitServices")
import RevitServices
from RevitServices.Persistence import DocumentManager
from RevitServices.Transactions import TransactionManager

doc = DocumentManager.Instance.CurrentDBDocument
uiapp = DocumentManager.Instance.CurrentUIApplication
app = uiapp.Application

#input IFC file path:
IFCfilepath = IN[0]
#define IFC import options:
IFC = Autodesk.Revit.DB.IFC
IFCopt = IFC.IFCImportOptions 
#optAxis = IFCopt.AutocorrectOffAxisLines(IN[1])
#optJoin = IFCopt.AutoJoin(IN[2])
#optRewrite = IFCopt.ForceImport(IN[3])
#open IFC document using the custom options (above)
IFCopen = app.OpenIFCDocument(IFCfilepath)

#importIFC = IFCio.ForceImport

#Save resulting Revit file to the destination path:
OUT = IFCopen.SaveAs(IN[1])
# ----------------------------------------
Result = Output(python_script)
