# Dynamo custom node PointCloud.Origin.dyf (Dynamo 1.3.2.2480)
# category: Zhukoven.Revit.PointClouds
# Input point cloud (.rcp) to get its origin point.

PointCloud = Input()
python_script = Python(IN[0]=PointCloud)
# ---------- python_script.python (26 lines) ----------
#Author Konstantin Zhukoven @ https://zhukoven.com
#Tested to work with Dynamo 1.3.0+
import clr
clr.AddReference("RevitAPI")
import Autodesk
from Autodesk.Revit.DB import *

clr.AddReference("RevitNodes")
import Revit
clr.ImportExtensions(Revit.GeometryConversion)
clr.ImportExtensions(Revit.Elements)

clr.AddReference("RevitServices")
import RevitServices
from RevitServices.Persistence import DocumentManager
from RevitServices.Transactions import TransactionManager

doc = DocumentManager.Instance.CurrentDBDocument
ref = Autodesk.Revit.DB.Reference
pCloud = UnwrapElement(IN[0])
scans = pCloud.GetScans()

for s in scans:
	coords = pCloud.GetScanOrigin(s)

OUT = scans, coords
# ----------------------------------------
code_block = CodeBlock(seq=python_script) { seq[0]; seq[1]; }
Name = Output(code_block.out0)
Origin = Output(code_block.out1)
