# Dynamo custom node Points.SortClockwise.dyf (Dynamo 1.3.3.4111)
# category: Zhukoven.DynamoCore
# This nodes attempts to re-arrange the list of points in a Clockwise order. Input boolean False if you wish to sort Counterclockwise

Points = Input()  # "Points[]"
X = Point.X(Points)
average = Math.Average(X)
Y = Point.Y(Points)
average_2 = Math.Average(Y)
byCoordinates = Point.ByCoordinates(x=average, y=average_2)
byTwoPoints = Vector.ByTwoPoints(start=byCoordinates, end=Points)
code_block = CodeBlock { 1; }
translate = Geometry.Translate(geometry=byCoordinates, yTranslation=code_block)
byTwoPoints_2 = Vector.ByTwoPoints(start=byCoordinates, end=translate)
ZAxis = Vector.ZAxis()
angleAboutAxis = Vector.AngleAboutAxis(byTwoPoints, byTwoPoints_2, ZAxis)
Ascending = Input(Ascending : bool = True)
sortIndexByValue = SortIndexByValue(angleAboutAxis, Ascending)
SortedPoints = Output(sortIndexByValue)  # "SortedPoints[]"
