# Dynamo custom node Railing.CalculateBalusterProfile.dyf (Dynamo 1.3.0.875)
# category: Zhukoven.Revit.Railings
# *NOTE* Processes only one railing instance at a time. Don't feed it with multiple elements!
# This node calculates baluster widths.

# group: Input railing instance. Only one at a time allowed
railing = Input(railing : Element)  # Input single railing element

geometry = Element.Geometry(railing)
explode = Geometry.Explode(geometry)
code_block = CodeBlock()
# ---------- code_block.designscript (2 lines) ----------
// Getting the horizontal surface from list
0;
# ----------------------------------------
getItemAtIndex = List.GetItemAtIndex(index=code_block)  # unwired: list
map = List.Map(list=explode, f_x=getItemAtIndex)
pointAtParameter = Surface.PointAtParameter(surface=map)
normalAtPoint = Surface.NormalAtPoint(surface=map, point=pointAtParameter)
Z = Vector.Z(normalAtPoint)
code_block_2 = CodeBlock(VectorZ=Z) { VectorZ==-1; }
filterByBoolMask = List.FilterByBoolMask(list=map, mask=code_block_2)
perimeterCurves = Surface.PerimeterCurves(filterByBoolMask.in)
count = List.Count(perimeterCurves@L2)
code_block_3 = CodeBlock { 4; }
lt = count < code_block_3
filterByBoolMask_2 = List.FilterByBoolMask(list=perimeterCurves, mask=lt)
length = Curve.Length(filterByBoolMask_2.in)
code_block_4 = CodeBlock(curve=length) { curve/Math.PI; }
sum = Math.Sum(code_block_4@L2)
round = Math.Round(sum)
uniqueItems = List.UniqueItems(round)
Diameter = Output(uniqueItems)  # Circular baluster diameter (if applicable)
length_2 = Curve.Length(filterByBoolMask_2.out)
round_2 = Math.Round(length_2)
flatten = Flatten(round_2)
uniqueItems_2 = List.UniqueItems(flatten)
Width = Output(uniqueItems_2)  # Rectangular baluster width (if applicable)
