# Dynamo custom node Railing.CountBalusters.dyf (Dynamo 1.3.0.875)
# category: Zhukoven.Revit.Railings
# *NOTE* Processes only one railing instance at a time. Don't feed it with multiple elements!
# Based on the "Railing.BalusterCount" node from the Rhythm package, this custom node removes false positives that resulted in incorrect number of balusters.

# group: Input railing instance. Only one at a time allowed
railing = Input(railing : Element)  # Input single railing element

geometry = Element.Geometry(railing)
explode = Geometry.Explode(geometry)
code_block = CodeBlock()
# ---------- code_block.designscript (4 lines) ----------
// Getting the horizontal surface from list
0;
// Vector-checker length
100;
# ----------------------------------------
getItemAtIndex = List.GetItemAtIndex(index=code_block.out0)  # unwired: list
map = List.Map(list=explode, f_x=getItemAtIndex)
pointAtParameter = Surface.PointAtParameter(surface=map)
normalAtPoint = Surface.NormalAtPoint(surface=map, point=pointAtParameter)
Z = Vector.Z(normalAtPoint)
code_block_2 = CodeBlock(VectorZ=Z) { VectorZ==-1; }
filterByBoolMask = List.FilterByBoolMask(list=pointAtParameter, mask=code_block_2)
count = Count(filterByBoolMask.in)
Number = Output(count)  # Number of railing balusters
