# Dynamo custom node Railing.GetHost.dyf (Dynamo 1.3.0.875)
# category: Zhukoven.Revit.Railings
# Get host element for selected railing

railing = Input()  # Input railing element
python_script = Python(IN[0]=railing)
# ---------- python_script.python (21 lines) ----------
#Tested in Revit 2016+ and Dynamo 1.3.0 
#Author © Konstantin Zhukoven @ https:\\zhukoven.com
import clr
clr.AddReference('RevitAPI')
from Autodesk.Revit.DB import *

clr.AddReference("RevitNodes")
import Revit
clr.ImportExtensions(Revit.Elements)

clr.AddReference("RevitServices")
import RevitServices
from RevitServices.Persistence import DocumentManager
doc = DocumentManager.Instance.CurrentDBDocument

railing = UnwrapElement(IN[0])
hid = railing.HostId
hashost = railing.HasHost
host = doc.GetElement(hid)
#Output
OUT = (hashost, host)
# ----------------------------------------
code_block = CodeBlock(seq=python_script) { seq [0]; seq [1]; }
isHosted = Output(code_block.out0)  # "isHosted?"
Element = Output(code_block.out1)
