# Dynamo custom node Railing.GetPath.dyf (Dynamo 1.3.0.875)
# category: Zhukoven.Revit.Railings
# Extract railing path as Dynamo curves from the input railing element. Only single railing element allowed.

railing = Input()  # Input single railing element
python_script = Python(IN[0]=railing)
# ---------- python_script.python (22 lines) ----------
#Tested in Revit 2016+ and Dynamo 1.3.0 
#Author © Konstantin Zhukoven @ https:\\zhukoven.com
import clr
clr.AddReference('RevitAPI')
from Autodesk.Revit.DB import *

clr.AddReference("RevitNodes")
import Revit
clr.ImportExtensions(Revit.Elements)
clr.ImportExtensions(Revit.GeometryConversion)

clr.AddReference("RevitServices")
import RevitServices
from RevitServices.Persistence import DocumentManager
doc = DocumentManager.Instance.CurrentDBDocument
curves = []
railing = UnwrapElement(IN[0])
rpath = railing.GetPath()
for i in rpath:
	curves.append(i.ToProtoType())
#Output
OUT = curves
# ----------------------------------------
Curves = Output(python_script)
