# Dynamo custom node Railing.GetTopRail.dyf (Dynamo 1.3.0.875)
# category: Zhukoven.Revit.Railings
# Extract top rail from the input railing element. Only single railing element allowed.

railing = Input()  # Input single railing element
python_script = Python(IN[0]=railing)
# ---------- python_script.python (20 lines) ----------
#Tested in Revit 2016+ and Dynamo 1.3.0 
#Author © Konstantin Zhukoven @ https:\\zhukoven.com
import clr
clr.AddReference('RevitAPI')
from Autodesk.Revit.DB import *

clr.AddReference("RevitNodes")
import Revit
clr.ImportExtensions(Revit.Elements)

clr.AddReference("RevitServices")
import RevitServices
from RevitServices.Persistence import DocumentManager
doc = DocumentManager.Instance.CurrentDBDocument

railing = UnwrapElement(IN[0])
rid = railing.TopRail
elt = doc.GetElement(rid)
#Output
OUT = elt
# ----------------------------------------
TopRail = Output(python_script)
