# Dynamo custom node Railing.TypeInfo.dyf (Dynamo 1.3.0.875)
# category: Zhukoven.Revit.Railings
# Input railing instance element to get its type info: railing type, primary handrail type, secondary handrail type, top rail type.

railing = Input()  # Input single railing element
python_script = Python(IN[0]=railing)
# ---------- python_script.python (25 lines) ----------
#Tested in Revit 2016+ and Dynamo 1.3.0 
#Author © Konstantin Zhukoven @ https:\\zhukoven.com
import clr
clr.AddReference('RevitAPI')
from Autodesk.Revit.DB import *

clr.AddReference("RevitNodes")
import Revit
clr.ImportExtensions(Revit.Elements)

clr.AddReference("RevitServices")
import RevitServices
from RevitServices.Persistence import DocumentManager
doc = DocumentManager.Instance.CurrentDBDocument

railing = UnwrapElement(IN[0])
#rid = railing.TopRail
rtype = railing.Document.GetElement(railing.GetTypeId())
#fname = rtype.FamilyName
lst = []
lst.append(rtype)
lst.append(doc.GetElement(rtype.PrimaryHandrailType))
lst.append(doc.GetElement(rtype.SecondaryHandrailType))
lst.append(doc.GetElement(rtype.TopRailType))
OUT = lst
# ----------------------------------------
code_block = CodeBlock(seq=python_script) { seq [0]; seq [1]; seq [2]; seq [3]; }
RailingType = Output(code_block.out0)
PrimaryHandrailType = Output(code_block.out1)
SecondaryHandrailType = Output(code_block.out2)
TopRailType = Output(code_block.out3)
