# Dynamo custom node Rebar.GetRebarShape.dyf (Dynamo 2.3.0.5885)
# category: Zhukoven.Revit
# Input rebar elements, including RebarInSystem, to get the underlying rebar shapes.

rebar = Input(rebar: var[]..[])  # Input rebars / rebarInSystem elements
code_block = CodeBlock(item=rebar) { DSCore.List.Flatten([item]); }
python_script = Python(IN[0]=code_block)
# ---------- python_script.python (26 lines) ----------
#Author Konstantin Zhukoven @ https://zhukoven.com
#Tested to work with Dynamo 1.3.0+
import clr
clr.AddReference("RevitAPI")
import Autodesk
from Autodesk.Revit.DB import *

clr.AddReference("RevitNodes")
import Revit
clr.ImportExtensions(Revit.GeometryConversion)
clr.ImportExtensions(Revit.Elements)

clr.AddReference("RevitServices")
import RevitServices
from RevitServices.Persistence import DocumentManager
doc = DocumentManager.Instance.CurrentDBDocument

Rebars = UnwrapElement(IN[0])

rebarShapes = []
for r in Rebars:
	rebarShapes.append(r.RebarShapeId)
	for i in rebarShapes:
		elt = doc.GetElement(i)

OUT = elt
# ----------------------------------------
rebarShape = Output(python_script)
