# Dynamo custom node RebarSet.Info.dyf (Dynamo 1.3.2.2480)
# category: Zhukoven.Revit.Rebar
# Input rebar set to get information about nested rebars: quantity, total length.

RebarSet = Input()
python_script = Python(IN[0]=RebarSet)
# ---------- python_script.python (28 lines) ----------
#Author Konstantin Zhukoven @ https://zhukoven.com
#Tested to work with Dynamo 1.3.0+
import clr
clr.AddReference('RevitAPI')
from Autodesk.Revit.DB import *
from Autodesk.Revit.DB.Structure import *

clr.AddReference('RevitNodes')
import Revit
clr.ImportExtensions(Revit.GeometryConversion)
clr.ImportExtensions(Revit.Elements)

clr.AddReference('RevitServices')
import RevitServices
from RevitServices.Persistence import DocumentManager
from RevitServices.Transactions import TransactionManager

doc = DocumentManager.Instance.CurrentDBDocument
#in Revit API: rebarSet means RebarInSystem
rebarSet = UnwrapElement(IN[0])
quantity, length = [], []

TransactionManager.Instance.EnsureInTransaction(doc)
for i in rebarSet:
	quantity.append(i.Quantity)
	length.append(i.TotalLength)
TransactionManager.Instance.TransactionTaskDone()
OUT = quantity, length
# ----------------------------------------
code_block = CodeBlock(seq=python_script) { seq[0]; seq[1]; }
Quantity = Output(code_block.out0)  # Identifies the number of bars in rebar set
TotalLength = Output(code_block.out1)  # The length of an individual bar multiplied by Quantity
