# Dynamo custom node RebarSet.PresentationMode.dyf (Dynamo 2.3.0.5885)
# category: Zhukoven.Revit
# Choose one the presentation modes for the input rebar set(s): Show All Rebars (default), Show First and Last Rebar, Show Middle Rebar. These presentation modes are view-specific, so be sure to input the desired view(s).

RebarSet = Input(RebarSet: var[]..[])
code_block = CodeBlock(item=RebarSet) { DSCore.List.Flatten([item]); }
view = Input(view: var[]..[])
ShowFirstLast = Input(ShowFirstLast: bool = false)
ShowMiddle = Input(ShowMiddle: bool = false)
python_script = Python(IN[0]=code_block, IN[1]=view, IN[2]=ShowFirstLast, IN[3]=ShowMiddle)
# ---------- python_script.python (39 lines) ----------
#Author Konstantin Zhukoven @ https://zhukoven.com
#Tested to work with Dynamo 1.3.0+
import clr
clr.AddReference('RevitAPI')
from Autodesk.Revit.DB import *
from Autodesk.Revit.DB.Structure import *
from Autodesk.Revit.DB.Structure import RebarPresentationMode

clr.AddReference('RevitNodes')
import Revit
clr.ImportExtensions(Revit.GeometryConversion)
clr.ImportExtensions(Revit.Elements)

clr.AddReference('RevitServices')
import RevitServices
from RevitServices.Persistence import DocumentManager
from RevitServices.Transactions import TransactionManager

doc = DocumentManager.Instance.CurrentDBDocument
#in Revit API: rebarSet means RebarInSystem
rebarSet = UnwrapElement(IN[0])
rebarMode = RebarPresentationMode
view = UnwrapElement(IN[1])
showFirstLast = IN[2]
showMiddle = IN[3]

rebarPresent = []

TransactionManager.Instance.EnsureInTransaction(doc)
for i in rebarSet:
	if showFirstLast:
		rebarPresent.append(i.SetPresentationMode(view, rebarMode.FirstLast))
	elif showMiddle:
		rebarPresent.append(i.SetPresentationMode(view, rebarMode.Middle))
	else:
		rebarPresent.append(i.SetPresentationMode(view, rebarMode.All))
		
TransactionManager.Instance.TransactionTaskDone()
OUT = rebarSet
# ----------------------------------------
RebarSets = Output(python_script)
