# Dynamo custom node RebarSet.ResetPresentationMode.dyf (Dynamo 2.3.0.5885)
# category: Zhukoven.Revit
# Reset rebar presentation mode to default (Show All Rebars) in view.

RebarSet = Input(RebarSet: var[]..[])
code_block = CodeBlock(item=RebarSet) { DSCore.List.Flatten([item]); }
view = Input(view: var[]..[])
python_script = Python(IN[0]=code_block, IN[1]=view)
# ---------- python_script.python (31 lines) ----------
#Author Konstantin Zhukoven @ https://zhukoven.com
#Tested to work with Dynamo 1.3.0+
import clr
clr.AddReference('RevitAPI')
from Autodesk.Revit.DB import *
from Autodesk.Revit.DB.Structure import *
from Autodesk.Revit.DB.Structure import RebarPresentationMode

clr.AddReference('RevitNodes')
import Revit
clr.ImportExtensions(Revit.GeometryConversion)
clr.ImportExtensions(Revit.Elements)

clr.AddReference('RevitServices')
import RevitServices
from RevitServices.Persistence import DocumentManager
from RevitServices.Transactions import TransactionManager

doc = DocumentManager.Instance.CurrentDBDocument
#in Revit API: rebarSet means RebarInSystem
rebarSet = UnwrapElement(IN[0])
rebarMode = RebarPresentationMode
view = UnwrapElement(IN[1])

rebarPresent = []

TransactionManager.Instance.EnsureInTransaction(doc)
for i in rebarSet:
	rebarPresent.append(i.ClearPresentationMode(view))		
TransactionManager.Instance.TransactionTaskDone()
OUT = rebarSet
# ----------------------------------------
RebarSets = Output(python_script)
