# Dynamo custom node RebarShape.GetByName.dyf (Dynamo 2.3.0.5885)
# category: Zhukoven.Revit
# Select rebar shape element by its name (String).

element_types = ElementTypes("RebarShape")  # graph input
all_elements_of_type = ElementsOfType(element_type=element_types)
name = Element.Name(element=all_elements_of_type)
str = Input(str: var[]..[])
code_block = CodeBlock(name=name, str=str) { name==str; }
filterByBoolMask = List.FilterByBoolMask(list=all_elements_of_type, mask=code_block)
element = Output(filterByBoolMask.in)
