# Dynamo custom node RebarShape.GetCurves.dyf (Dynamo 2.3.0.5885)
# category: Zhukoven.Revit
# Generate curves for the rebar shape, as used in the shape browser.

RebarShape = Input(RebarShape: var[]..[])  # Input rebar shape element
code_block = CodeBlock(item=RebarShape) { DSCore.List.Flatten([item]); }
python_script = Python(IN[0]=code_block)
# ---------- python_script.python (21 lines) ----------
#Author Konstantin Zhukoven @ https://zhukoven.com
#Tested to work with Dynamo 1.3.0+
import clr
clr.AddReference("RevitAPI")
import Autodesk
from Autodesk.Revit.DB import *

clr.AddReference("RevitNodes")
import Revit
clr.ImportExtensions(Revit.GeometryConversion)
clr.ImportExtensions(Revit.Elements)

RebarShape = UnwrapElement(IN[0])

for r in RebarShape:
	bCurves = r.GetCurvesForBrowser()
	curves = []
	for c in bCurves:
		curves.append(c.ToProtoType())

OUT = curves
# ----------------------------------------
Curves = Output(python_script)
