# Dynamo custom node RevisionCloud.ByPoint.dyf (Dynamo 1.3.2.2480)
# category: Zhukoven.Revit.Revisions
# Place revision cloud by specified point.

view = Input(view : View)
point = Input(point : Point)
byOrigin = CoordinateSystem.ByOrigin(point)
width = Input(width : double = 1000)
length = Input(length : double = 1000)
byWidthLength = Rectangle.ByWidthLength(cs=byOrigin, width=width, length=length)
explode = Geometry.Explode(byWidthLength)
reverse = Curve.Reverse(explode)
revision = Input(revision : Element)
byCurve = RevisionCloud.ByCurve(view, reverse, revision)
RevisionCloud = Output(byCurve)
