# Dynamo custom node RevitLinks.Reload.dyf (Dynamo 1.3.0.875)
# category: Zhukoven.Revit.Links
# Reloads all linked Revit files loaded into the current document. Do NOT use this node in Automatic mode!

Boolean = Input(Boolean: bool=false)
python_script = Python(IN[0]=Boolean)
# ---------- python_script.python (32 lines) ----------
#Working from Dynamo 1.0.0
#Based on the code posted by Nicklas Østertgaard  nvo@bimshark.com / nvo@shl.fk
import clr
clr.AddReference('ProtoGeometry')
from Autodesk.DesignScript.Geometry import *
# Import ToDSType(bool) extension method
clr.AddReference("RevitNodes")
import Revit
clr.ImportExtensions(Revit.Elements)
# Import geometry conversion extension methods
clr.ImportExtensions(Revit.GeometryConversion)
# Import DocumentManager and TransactionManager
clr.AddReference("RevitServices")
import RevitServices
from RevitServices.Persistence import DocumentManager
from RevitServices.Transactions import TransactionManager
from System.Collections.Generic import *
# Import RevitAPI
clr.AddReference("RevitAPI")
import Autodesk
from Autodesk.Revit.DB import *
doc = DocumentManager.Instance.CurrentDBDocument
uiapp = DocumentManager.Instance.CurrentUIApplication
app = uiapp.Application
uidoc=DocumentManager.Instance.CurrentUIApplication.ActiveUIDocument
collector = Autodesk.Revit.DB.FilteredElementCollector(doc)
linkInstances = collector.OfClass(Autodesk.Revit.DB.RevitLinkInstance)

for i in linkInstances:
	RevitLinkType  = doc.GetElement(i.GetTypeId())
	RevitLinkType.Load();
OUT= "Successfully reloaded"
# ----------------------------------------
OUT = Output(python_script)
