# Dynamo custom node Room.ByPhaseLevelView.dyf (Dynamo 2.3.0.5885)
# category: Zhukoven.Revit
# Place room elements at the desired phase in the selected view. Note that the phase of the selected view would be changed to be aligned with the phase that you choose in Dynamo.
# packages: Zhukoven.com 2019.5.7

phase = Input(phase: var[]..[])
level = Input(level: var[]..[])
view = Input(view: var[]..[])
setPhase = Custom[View.SetPhase](Phase=phase, view)  # package Zhukoven.com; Input phase that you would like to set to the desired view.
python_script = Python(IN[0]=phase, IN[1]=level, IN[2]=setPhase.Result)
# ---------- python_script.python (34 lines) ----------
#Author Konstantin Zhukoven @ https://zhukoven.com
#Tested to work with Dynamo 1.3.0+
import clr
clr.AddReference("RevitNodes")
import Revit

# Import DocumentManager and TransactionManager
clr.AddReference("RevitServices")
import RevitServices
from RevitServices.Persistence import DocumentManager
from RevitServices.Transactions import TransactionManager
# Import RevitAPI
clr.AddReference("RevitAPI")
import Autodesk
from Autodesk.Revit.DB import *
from Autodesk.Revit.Creation.Document import NewRooms2

doc = DocumentManager.Instance.CurrentDBDocument
phase = UnwrapElement(IN[0])
lvl = UnwrapElement(IN[1])

TransactionManager.Instance.EnsureInTransaction(doc)
viewPhase = IN[2]
if viewPhase:
	createRoom = doc.Create.NewRooms2(lvl,phase)
	if isinstance(createRoom, list):
		roomElement = doc.GetElement(createRoom)
	else:
		roomElement = []
		for i in createRoom:
			roomElement.append(doc.GetElement(i))
TransactionManager.Instance.TransactionTaskDone()

OUT = roomElement
# ----------------------------------------
rooms = Output(python_script)
