# Dynamo custom node Room.CreateUnplacedAtPhase.dyf (Dynamo 2.3.0.5885)
# category: Zhukoven.Revit
# This node creates unplaces room at the desired phase, using number (str.) and name (str.) provided.

phase = Input(phase: var[]..[])
roomName = Input(roomName: var[]..[])  # String
roomNumber = Input(roomNumber: var[]..[])  # String
python_script = Python(IN[0]=phase, IN[1]=roomName, IN[2]=roomNumber)
# ---------- python_script.python (27 lines) ----------
#Author Konstantin Zhukoven @ https://zhukoven.com
#Tested to work with Dynamo 1.3.0+
import clr
clr.AddReference("RevitNodes")
import Revit

# Import DocumentManager and TransactionManager
clr.AddReference("RevitServices")
import RevitServices
from RevitServices.Persistence import DocumentManager
from RevitServices.Transactions import TransactionManager
# Import RevitAPI
clr.AddReference("RevitAPI")
import Autodesk
from Autodesk.Revit.DB import *
from Autodesk.Revit.Creation.Document import NewRoom

doc = DocumentManager.Instance.CurrentDBDocument
phase = UnwrapElement(IN[0])

TransactionManager.Instance.EnsureInTransaction(doc)
createRoom = doc.Create.NewRoom(phase)
createRoom.Name = IN[1]
createRoom.Number = IN[2]
TransactionManager.Instance.TransactionTaskDone()

OUT = createRoom
# ----------------------------------------
room = Output(python_script)
