# Dynamo custom node ScopeBox.CenterPoint.dyf (Dynamo 2.3.0.5885)
# category: Zhukoven.Revit
# This node takes Scope Box element and extracts its center point as location.
# packages: Zhukoven.com 2019.5.7

scopeBox = Input(scopeBox: Revit.Elements.Element)  # Input Scope Box element(s)
boundingBox = Element.BoundingBox(element=scopeBox)
# note: Node from "Zhukoven.com" package
centerPoint = Custom[BoundingBox.CenterPoint](boundingBox=boundingBox)  # package Zhukoven.com; Input Bounding Box element to get its center point. This node is little and lightweight, as it doesn't convert bounding box to geometry to get its centroid point.
point = Output(centerPoint)
