# Dynamo custom node SharedParameters.GUID.dyf (Dynamo 1.3.3.4111)
# category: Zhukoven.Revit.SharedParameters
# Get unique GUIDs of the shared parameters loaded in the Revit project.

element_types = ElementTypes("SharedParameterElement")
all_elements_of_type = ElementsOfType(element_types)
python_script = Python(IN[0]=all_elements_of_type)
# ---------- python_script.python (14 lines) ----------
#Author Konstantin Zhukoven @ https://zhukoven.com
#Tested to work with Dynamo 1.3.0+
import clr
clr.AddReference("RevitAPI")
import Autodesk
from Autodesk.Revit.DB import *

param = UnwrapElement(IN[0])
guid, name = [],[]

for i in param:
	name.append(i.Name)
	guid.append(i.GuidValue)
OUT = name, guid
# ----------------------------------------
code_block = CodeBlock(seq=python_script) { seq[0]; seq[1]; }
SharedParameterName = Output(code_block.out0)
SharedParameterGUID = Output(code_block.out1)
