# Dynamo custom node SharedParameters.Info.dyf (Dynamo 1.3.3.4111)
# category: Zhukoven.Revit.SharedParameters
# Get the following information about shared parameters loaded in the Revit project: parameter group, parameter type, unit type.

element_types = ElementTypes("SharedParameterElement")
all_elements_of_type = ElementsOfType(element_types)
python_script = Python(IN[0]=all_elements_of_type)
# ---------- python_script.python (16 lines) ----------
#Author Konstantin Zhukoven @ https://zhukoven.com
#Tested to work with Dynamo 1.3.0+
import clr
clr.AddReference("RevitAPI")
import Autodesk
from Autodesk.Revit.DB import *

param = UnwrapElement(IN[0])
groups, types, units = [],[],[]

for i in param:
	dfn = i.GetDefinition()
	groups.append(str(dfn.ParameterType))
	types.append(str(dfn.ParameterGroup))
	units.append(str(dfn.UnitType))	
OUT = groups, types, units
# ----------------------------------------
code_block = CodeBlock(seq=python_script) { seq[0]; seq[1]; seq[2]; }
SharedParameterType = Output(code_block.out0)
SharedParameterGroup = Output(code_block.out1)
SharedParameterUnits = Output(code_block.out2)
