# Dynamo custom node Sheet.Viewports.dyf (Dynamo 2.3.0.5885)
# category: Zhukoven.Revit
# Query viewports from the input sheet(s).

sheet = Input(sheet: var[]..[])
code_block = CodeBlock(item=sheet) { DSCore.List.Flatten([item]); }
python_script = Python(IN[0]=code_block)
# ---------- python_script.python (26 lines) ----------
#Author Konstantin Zhukoven @ https://zhukoven.com
#Tested to work with Dynamo 1.3.3+
import clr
clr.AddReference("RevitAPI")
import Autodesk
from Autodesk.Revit.DB import *

clr.AddReference("RevitNodes")
import Revit
clr.ImportExtensions(Revit.GeometryConversion)
clr.ImportExtensions(Revit.Elements)

clr.AddReference("RevitServices")
import RevitServices
from RevitServices.Persistence import DocumentManager
doc = DocumentManager.Instance.CurrentDBDocument

sheets = UnwrapElement(IN[0])

viewports = []
for v in sheets:
	viewportIds = v.GetAllViewports()
	for i in viewportIds:
		elt = doc.GetElement(i)
		viewports.append(elt)
OUT = viewports
# ----------------------------------------
viewports = Output(python_script)
