# Dynamo custom node Stairs.GetStairsRuns.dyf (Dynamo 2.3.0.5885)
# category: Zhukoven.Revit
# This node returns all the stairs run components in the stairs.

Stair = Input(Stair: var[]..[])  # Input stair(s) element(s)
code_block = CodeBlock(item=Stair) { DSCore.List.Flatten([item]); }
python_script = Python(IN[0]=code_block)
# ---------- python_script.python (22 lines) ----------
#Tested to work with Dynamo 1.3.0 + 
#Author © Konstantin Zhukoven @ https:\\zhukoven.com
import clr
clr.AddReference('RevitAPI')
from Autodesk.Revit.DB import *

clr.AddReference("RevitNodes")
import Revit
clr.ImportExtensions(Revit.Elements)

clr.AddReference("RevitServices")
import RevitServices
from RevitServices.Persistence import DocumentManager
doc = DocumentManager.Instance.CurrentDBDocument

stair = UnwrapElement(IN[0])
for i in stair:
	runs = i.GetStairsRuns()
	for i in runs:
		elt = doc.GetElement(i)
#Output
OUT = elt
# ----------------------------------------
StairsRuns = Output(python_script)
