# Dynamo custom node Stairs.Info.dyf (Dynamo 2.3.0.5885)
# category: Zhukoven.Revit
# This node returns some basic data from the input stair element(s): risers' and treads' height and number, stories, level, etc.

Stair = Input(Stair: var[]..[])  # Input stair(s) element(s)
code_block = CodeBlock(item=Stair) { DSCore.List.Flatten([item]); }
python_script = Python(IN[0]=code_block)
# ---------- python_script.python (27 lines) ----------
#Tested to work with Dynamo 1.3.0 + 
#Author © Konstantin Zhukoven @ https:\\zhukoven.com
import clr
clr.AddReference('RevitAPI')
from Autodesk.Revit.DB import *

clr.AddReference("RevitNodes")
import Revit
clr.ImportExtensions(Revit.Elements)

clr.AddReference("RevitServices")
import RevitServices
from RevitServices.Persistence import DocumentManager
doc = DocumentManager.Instance.CurrentDBDocument

stair = UnwrapElement(IN[0])
for i in stair:
	actualRH = i.ActualRiserHeight
	actualRN = i.ActualRisersNumber
	desiredRN = i.DesiredRisersNumber
	actualTD = i.ActualTreadDepth
	actualTN = i.ActualTreadsNumber
	stories = i.NumberOfStories
	height = i.Height
	component = i.IsByComponent(doc, i.Id)
#Output
OUT = actualRH, actualRN, desiredRN, actualTD, actualTN, stories, height, component
# ----------------------------------------
code_block_2 = CodeBlock(seq=python_script) { seq[0]; seq[1]; seq[2]; seq[3]; seq[4]; seq[5]; seq[6]; seq[7]; }
ActualRiserHeight = Output(code_block_2.out0)  # The actual height of the stairs risers in the stairs
ActualRisersNumber = Output(code_block_2.out1)  # The total number of actually created risers in model
DesiredRisersNumber = Output(code_block_2.out2)  # The number of risers is calculated based on the height between levels
ActualTreadDepth = Output(code_block_2.out3)  # The actual depth of the stairs treads in the stairs, actual tread depth is equal to minimum tread depth by default
ActualTreadsNumber = Output(code_block_2.out4)  # The number of treads actually created in the stairs
NumberOfStories = Output(code_block_2.out5)  # The number of stories of a multi-story stair, or 1 for a single-story stair
StairHeight = Output(code_block_2.out6)  # The height of the stair between the base and top levels
IsByComponent = Output(code_block_2.out7)  # Indicates if the stairs is created by stairs components(runs, landings and supports)
