# Dynamo custom node SteelConnection.IsCustom.dyf (Dynamo 2.3.0.5885)
# category: Zhukoven.Revit
# Input structural steel connection to check if it is custom or not (boolean output)

StlCon = Input(StlCon: var[]..[])  # Input Structural Steel Connection element(s)
code_block = CodeBlock(item=StlCon) { DSCore.List.Flatten([item]); }
python_script = Python(IN[0]=code_block)
# ---------- python_script.python (18 lines) ----------
#Author © Konstantin Zhukoven @ https:\\zhukoven.com
import clr
#Import Revit Services
clr.AddReference("RevitServices")
import RevitServices
from RevitServices.Persistence import DocumentManager
from RevitServices.Transactions import TransactionManager

#Import Revit API
clr.AddReference("RevitAPI")
import Autodesk
from Autodesk.Revit.DB import Steel

#Start Transaction
stlcon = UnwrapElement(IN[0])
for i in stlcon:
	custom = i.IsCustom()
OUT = custom
# ----------------------------------------
Custom = Output(python_script)
