# Dynamo custom node String.AddPrefixSuffix.dyf (Dynamo 2.3.0.5885)
# category: Zhukoven.DynamoCore
# Add prefix and suffix to the input string.

str = Input(str: var[]..[])  # Input string
pref = Input(pref: var[]..[])  # String
suff = Input(suff: var[]..[])  # String
code_block = CodeBlock(t3=str, t4=pref, t6=suff) { t2 = DSCore.String.Insert(t3, 0, t4); t5 = DSCore.String.Length(t2); t7 = DSCore.String.Insert(t2, t5, t6); }
str_2 = Output(code_block.t7)  # "str"; Output string with prefix & suffix
