# Dynamo custom node Topography.PolySurface.dyf (Dynamo 1.3.0.875)
# category: Zhukoven.Revit.Topography
# Convert topography element to polysurface

Topo = Input(Topo : Topography)
mesh = Topography.Mesh(Topo)
vertexPositions = Mesh.VertexPositions(mesh)
faceIndices = Mesh.FaceIndices(mesh)
A = IndexGroup.A(faceIndices)
B = IndexGroup.B(faceIndices)
C = IndexGroup.C(faceIndices)
create = List.Create(A, B, C)
transpose = List.Transpose(create)
getItemAtIndex = List.GetItemAtIndex(list=vertexPositions, index=transpose)
byPerimeterPoints = Surface.ByPerimeterPoints(getItemAtIndex)
byJoinedSurfaces = PolySurface.ByJoinedSurfaces(byPerimeterPoints)
PolySurface = Output(byJoinedSurfaces)
