# Dynamo custom node UI.SelectionBox.dyf (Dynamo 1.3.0.875)
# category: Zhukoven.Revit.UI
# Activate Revit 3D selection box by selected elements.

RunIt = Input(RunIt : bool = false)
python_script = Python(IN[0]=RunIt)
# ---------- python_script.python (28 lines) ----------
import clr

clr.AddReference("RevitServices")
import RevitServices
from RevitServices.Persistence import DocumentManager
from RevitServices.Transactions import TransactionManager
doc =  DocumentManager.Instance.CurrentDBDocument
uidoc = DocumentManager.Instance.CurrentUIDocument
app = DocumentManager.Instance.CurrentUIApplication.Application
uiapp = DocumentManager.Instance.CurrentUIApplication

clr.AddReference("RevitNodes")
import Revit
clr.ImportExtensions(Revit.Elements)
clr.ImportExtensions(Revit.GeometryConversion)

clr.AddReference("RevitAPI")
from Autodesk.Revit.DB import *
clr.AddReference("RevitAPIUI")
from Autodesk.Revit.UI import *
output = []
postcmd = RevitCommandId.LookupPostableCommandId(PostableCommand.SelectionBox)
if IN[0] == True:
	uiapp.PostCommand(postcmd)
	output = True
else :
	output = 'Set RunIt to true'
OUT = output
# ----------------------------------------
Result = Output(python_script)
