# Dynamo custom node Vector.IsParallelToView.dyf (Dynamo 1.3.2.2480)
# category: Zhukoven.Revit.Views
# This node checks if a given vector is parallel to a given view.

vector = Input(vector : Vector)
view = Input()
python_script = Python(IN[0]=view)
# ---------- python_script.python (8 lines) ----------
import clr
clr.AddReference('RevitNodes')
import Revit
clr.ImportExtensions(Revit.GeometryConversion)

view = UnwrapElement(IN[0])

OUT = view.RightDirection.ToVector()
# ----------------------------------------
isParallel = Vector.IsParallel(vector, python_script)
bool = Output(isParallel)
