# Dynamo custom node View.SetPhase.dyf (Dynamo 2.3.0.5885)
# category: Zhukoven.Revit
# Input phase that you would like to set to the desired view.

phase = Input(phase: var[]..[])
view = Input(view: var[]..[])
python_script = Python(IN[0]=phase, IN[1]=view)
# ---------- python_script.python (29 lines) ----------
#Author Konstantin Zhukoven @ https://zhukoven.com
#Tested to work with Dynamo 1.3.0+
import clr
clr.AddReference('RevitAPI')
from Autodesk.Revit.DB import *

clr.AddReference("RevitNodes")
import Revit
clr.ImportExtensions(Revit.Elements)

clr.AddReference("RevitServices")
import RevitServices
from RevitServices.Persistence import DocumentManager
from RevitServices.Transactions import TransactionManager

doc = DocumentManager.Instance.CurrentDBDocument
phase = UnwrapElement(IN[0])
view = UnwrapElement(IN[1])
result = []

TransactionManager.Instance.EnsureInTransaction(doc)
try:
	view.get_Parameter(BuiltInParameter.VIEW_PHASE).Set(phase.Id)
	result.append(True)
except:
	result.append(False)
TransactionManager.Instance.TransactionTaskDone()

OUT = (view,result)
# ----------------------------------------
code_block = CodeBlock(seq=python_script) { seq[0]; seq[1]; }
view_2 = Output(code_block.out0)  # "view"
result = Output(code_block.out1)  # Boolean
