# Dynamo custom node View3D.CreateIsometric.dyf (Dynamo 1.3.3.4651)
# category: Zhukoven.Revit.Views
# This node creates new 3D view inside the Revit project.

element_types = ElementTypes("ViewFamilyType")
all_elements_of_type = ElementsOfType(element_types)
name = Element.Name(all_elements_of_type)
code_block = CodeBlock { "3D"; }
contains = String.Contains(str=name, searchFor=code_block)
filterByBoolMask = List.FilterByBoolMask(list=all_elements_of_type, mask=contains)
firstItem = List.FirstItem(filterByBoolMask.in)
python_script = Python(IN[0]=firstItem)
# ---------- python_script.python (24 lines) ----------
#Author Konstantin Zhukoven @ https://zhukoven.com
#Tested to work with Dynamo 1.3.0+
import clr
clr.AddReference('RevitAPI')
from Autodesk.Revit.DB import *

clr.AddReference("RevitNodes")
import Revit
clr.ImportExtensions(Revit.Elements)

clr.AddReference("RevitServices")
import RevitServices
from RevitServices.Persistence import DocumentManager
from RevitServices.Transactions import TransactionManager

doc = DocumentManager.Instance.CurrentDBDocument
viewFamilyType = UnwrapElement(IN[0])
views = []
TransactionManager.Instance.EnsureInTransaction(doc)
v = View3D.CreateIsometric(doc, viewFamilyType.Id)
views.append(v)
TransactionManager.Instance.TransactionTaskDone()

OUT = (views)
# ----------------------------------------
view3D = Output(python_script)
