# Dynamo custom node Viewport.Sheet.dyf (Dynamo 2.3.0.5885)
# category: Zhukoven.Revit
# Query the sheet that owns the input viewport.

viewport = Input(viewport: var[]..[])
code_block = CodeBlock(item=viewport) { DSCore.List.Flatten([item]); }
python_script = Python(IN[0]=code_block)
# ---------- python_script.python (27 lines) ----------
#Author Konstantin Zhukoven @ https://zhukoven.com
#Tested to work with Dynamo 1.3.3+
import clr
clr.AddReference("RevitAPI")
import Autodesk
from Autodesk.Revit.DB import *

clr.AddReference("RevitNodes")
import Revit
clr.ImportExtensions(Revit.GeometryConversion)
clr.ImportExtensions(Revit.Elements)

clr.AddReference("RevitServices")
import RevitServices
from RevitServices.Persistence import DocumentManager
doc = DocumentManager.Instance.CurrentDBDocument

viewports = UnwrapElement(IN[0])

views, elts = [], []
for v in viewports:
	vList = v.OwnerViewId
	views.append(vList)
for i in views:
	elt = doc.GetElement(i)
	elts.append(elt)
OUT = elts
# ----------------------------------------
sheet = Output(python_script)
