# Dynamo custom node Viewport.View.dyf (Dynamo 1.3.4.6666)
# category: Zhukoven.Revit.Views
# Query the view associated with the input viewport.

viewport_s = Input()  # "viewport(s)"
code_block = CodeBlock(item=viewport_s) { Flatten({item}); }
python_script = Python(IN[0]=code_block)
# ---------- python_script.python (27 lines) ----------
#Author Konstantin Zhukoven @ https://zhukoven.com
#Tested to work with Dynamo 1.3.3+
import clr
clr.AddReference("RevitAPI")
import Autodesk
from Autodesk.Revit.DB import *

clr.AddReference("RevitNodes")
import Revit
clr.ImportExtensions(Revit.GeometryConversion)
clr.ImportExtensions(Revit.Elements)

clr.AddReference("RevitServices")
import RevitServices
from RevitServices.Persistence import DocumentManager
doc = DocumentManager.Instance.CurrentDBDocument

viewports = UnwrapElement(IN[0])

views, elts = [], []
for v in viewports:
	vList = v.ViewId
	views.append(vList)
for i in views:
	elt = doc.GetElement(i)
	elts.append(elt)
OUT = elts
# ----------------------------------------
view = Output(python_script)
