# Dynamo custom node WallSweep.GetMaterial.dyf (Dynamo 1.3.2.2480)
# category: Zhukoven.Revit.Walls
# This node takes wall sweep elements and extracts their materials. It works both with standard sweeps, and wall assemblies.

WallSweep = Input()  # Input wall sweep elements
python_script = Python(IN[0]=WallSweep)
# ---------- python_script.python (21 lines) ----------
#Author Konstantin Zhukoven @ https://zhukoven.com
#Tested to work with Dynamo 1.3.0+
import clr
clr.AddReference('RevitAPI')
from Autodesk.Revit.DB import *

clr.AddReference("RevitNodes")
import Revit
clr.ImportExtensions(Revit.Elements)

clr.AddReference("RevitServices")
import RevitServices
from RevitServices.Persistence import DocumentManager
doc = DocumentManager.Instance.CurrentDBDocument

swp = UnwrapElement(IN[0])
swMaterial = []
for i in swp:
	swMaterial.append(doc.GetElement(i.GetWallSweepInfo().MaterialId))
#Output
OUT = swMaterial
# ----------------------------------------
Material = Output(python_script)
