# Dynamo custom node Walls.AllowJoinAtEnd.dyf (Dynamo 1.3.2.2480)
# category: Zhukoven.Revit.Walls
# Allows the wall's end to join to other walls. If that end is near other walls it will become joined as a result.

Walls = Input()  # Input walls to be joined
JoinAtStart = Input(JoinAtStart:bool=true)
JoinAtEnd = Input(JoinAtEnd:bool=true)
python_script = Python(IN[0]=Walls, IN[1]=JoinAtStart, IN[2]=JoinAtEnd)
# ---------- python_script.python (31 lines) ----------
#Author Konstantin Zhukoven @ https://zhukoven.com
#Tested to work with Dynamo 1.3.0+
import clr
clr.AddReference('RevitServices')

import RevitServices
from RevitServices.Persistence import DocumentManager
from RevitServices.Transactions import TransactionManager

clr.AddReference('RevitAPI')
from Autodesk.Revit.DB import WallUtils

doc = DocumentManager.Instance.CurrentDBDocument

walls = UnwrapElement(IN[0])
startSwitch = IN[1]
endSwitch = IN[2]
success, error = [],[]

for i in walls:
	try:
		TransactionManager.Instance.EnsureInTransaction(doc)
		if startSwitch == True:
			WallUtils.AllowWallJoinAtEnd(i,0)
		if endSwitch == True:
			WallUtils.AllowWallJoinAtEnd(i,1)
		TransactionManager.Instance.TransactionTaskDone()
		success.append(i)
	except:
		error.append("Error: Element category" +str(i.Category.Name))
OUT = (success,error)
# ----------------------------------------
code_block = CodeBlock(seq=python_script) { seq[0]; seq[1]; }
Success = Output(code_block.out0)
Error = Output(code_block.out1)
