# Dynamo custom node Walls.IsWallJoinAllowed.dyf (Dynamo 1.3.2.2480)
# category: Zhukoven.Revit.Walls
# Identifies if the indicated end of the wall allows joins or not.

Walls = Input()  # Input walls to be checked
python_script = Python(IN[0]=Walls)
# ---------- python_script.python (24 lines) ----------
#Author Konstantin Zhukoven @ https://zhukoven.com
#Tested to work with Dynamo 1.3.0+
import clr
clr.AddReference('RevitServices')

import RevitServices
from RevitServices.Persistence import DocumentManager
from RevitServices.Transactions import TransactionManager

clr.AddReference('RevitAPI')
from Autodesk.Revit.DB import WallUtils

doc = DocumentManager.Instance.CurrentDBDocument

walls = UnwrapElement(IN[0])
startList, endList = [], []
for i in walls:
	TransactionManager.Instance.EnsureInTransaction(doc)
	startAllowed = WallUtils.IsWallJoinAllowedAtEnd(i,0)
	endAllowed = WallUtils.IsWallJoinAllowedAtEnd(i,1)
	TransactionManager.Instance.TransactionTaskDone()
	startList.append(startAllowed)
	endList.append(endAllowed)
OUT = startList, endList
# ----------------------------------------
code_block = CodeBlock(seq=python_script) { seq[0]; seq[1]; }
JoinAtStart = Output(code_block.out0)  # Boolean
JoinAtEnd = Output(code_block.out1)  # Boolean
