# Dynamo custom node Workset.Create.dyf (Dynamo 2.3.0.5885)
# category: Zhukoven.Revit
# Create new worksets with the input names (strings) in the current document.

worksetName = Input(worksetName: var[]..[])  # Input workset name(s) as string(s)
code_block = CodeBlock(item=worksetName) { DSCore.List.Flatten([item]); }
python_script = Python(IN[0]=code_block)
# ---------- python_script.python (28 lines) ----------
#Author Konstantin Zhukoven @ https://zhukoven.com
#Tested to work with Dynamo 1.3.3+
import clr
clr.AddReference("RevitServices")
import RevitServices
from RevitServices.Persistence import DocumentManager
from RevitServices.Transactions import TransactionManager
# Import RevitAPI
clr.AddReference("RevitAPI")
import Autodesk
from Autodesk.Revit.DB import *

doc = DocumentManager.Instance.CurrentDBDocument

names = IN[0]
newWorksets = []

wsTable = doc.GetWorksetTable()
for i in names:
	if wsTable.IsWorksetNameUnique(doc, i):
		# Start Transaction
		TransactionManager.Instance.EnsureInTransaction(doc)
		newWorksets.append(Workset.Create(doc,i))
		# End Transaction
		TransactionManager.Instance.TransactionTaskDone()
		OUT = newWorksets
	else:
		OUT = "Error: workset name is already in use"
# ----------------------------------------
workset = Output(python_script)  # Workset element
