# Dynamo custom node Workset.Id.dyf (Dynamo 2.3.0.5885)
# category: Zhukoven.Revit
# Get Ids from the input workset elements.

workset = Input(workset: var[]..[])  # Input Workset element(s)
code_block = CodeBlock(item=workset) { DSCore.List.Flatten([item]); }
python_script = Python(IN[0]=code_block)
# ---------- python_script.python (15 lines) ----------
#Author Konstantin Zhukoven @ https://zhukoven.com
#Tested to work with Dynamo 1.3.3+
import clr
# Import RevitAPI
clr.AddReference("RevitAPI")
import Autodesk
from Autodesk.Revit.DB import *

worksets = IN[0]
worksetInt = []

for i in worksets:
	worksetInt.append(i.Id.IntegerValue)

OUT =  worksetInt
# ----------------------------------------
worksetId = Output(python_script)
